vi "Specifications_haccp_iVario.gviweb"   [G Web Development Software 22.3.0]
inputs:
  "Output XML array": string[]
  "Error in": error
  "Energy consumption:": string
outputs:
  "Device Type": string
  "Software version": string
  "Error out": error
  "Start date": string
  "Temp Einheit": string
  "Rezept name": string
  "Charge nr": string
  "Spezifications": T1
panel indicators:
  "GUID": string
  "Serial number": string
types:
  T1 = cluster{"Device type:": string, "Device side:": string, "Serial number:": string, "Software version:": string, "Start date:": string, "Charge number:": string, "Prozess-Typ:": string, "Cooking programme name:": string, "Energy consumption:": string}
uses:
  NI::G Core::Strings::Trim Whitespace.gvi
diagram:
  s1 = ""  # shift register
  s2 = ""  # shift register
  s3 = ""  # shift register
  s4 = ""  # shift register
  s5 = ""  # shift register
  s6 = ""  # shift register
  s7 = ""  # shift register
  s8 = ""  # shift register
  for {
    w1 = each element of $"Output XML array"
    Match Pattern(regular expression=">", string=w1) -> (after substring=w2, before substring=w3)
    case (w3) {
      frame "False", Default {
        w4 = s1
        w5 = s2
        w6 = s3
        w7 = s4
        w8 = s5
        w9 = $"Error in"
        w10 = s6
        w11 = s7
        w12 = s8
      }
      frame "1.7" {
        w4 = s1
        w5 = s2
        w6 = w2
        w7 = s4
        w8 = s5
        w9 = $"Error in"
        w10 = s6
        w11 = s7
        w12 = s8
      }
      frame "1.11" {
        w4 = s1
        w5 = s2
        w6 = s3
        w7 = s4
        w8 = s5
        w9 = $"Error in"
        w10 = s6
        w11 = s7
        w12 = w3
      }
      frame "1.3" {
        w4 = s1
        w5 = s2
        w6 = s3
        w7 = s4
        w8 = s5
        w9 = $"Error in"
        w10 = s6
        w11 = w2
        w12 = s8
      }
      frame "1.16" {
        w4 = s1
        w5 = s2
        w6 = s3
        w7 = s4
        w8 = s5
        w9 = $"Error in"
        w10 = w2
        w11 = s7
        w12 = s8
      }
      frame "1.10" {
        w4 = s1
        w5 = s2
        w6 = s3
        w7 = s4
        w8 = w2
        w9 = $"Error in"
        w10 = s6
        w11 = s7
        w12 = s8
      }
      frame "1.4" {
        w4 = s1
        w5 = s2
        w6 = s3
        w7 = w2
        w8 = s5
        w9 = $"Error in"
        w10 = s6
        w11 = s7
        w12 = s8
      }
      frame "1.6/" {
        call "Trim Whitespace.gvi"(string=w2) -> (trimmed string=w13)
        Match Pattern(regular expression="<_1.7>", string=w13) -> (after substring=w6)
        w4 = s1
        w5 = s2
        w7 = s4
        w8 = s5
        w9 = $"Error in"
        w10 = s6
        w11 = s7
        w12 = s8
      }
      frame "1.2" {
        w4 = w2
        w5 = s2
        w6 = s3
        w7 = s4
        w8 = s5
        w9 = $"Error in"
        w10 = s6
        w11 = s7
        w12 = s8
      }
      frame "1.5" {
        w4 = s1
        w5 = w2
        w6 = s3
        w7 = s4
        w8 = s5
        w9 = $"Error in"
        w10 = s6
        w11 = s7
        w12 = s8
      }
    }
    next s1 = w4
    next s2 = w5
    next s3 = w6
    next s4 = w7
    next s5 = w8
    next s6 = w10
    next s7 = w11
    next s8 = w12
  }
  $"Software version" <- s2
  $"Rezept name" <- "Operating mode / \nCooking process"
  call "Trim Whitespace.gvi"(string=s5) -> (trimmed string=w14)
  call "Trim Whitespace.gvi"(string=s1) -> (trimmed string=w15)
  call "Trim Whitespace.gvi"(string=s4) -> (trimmed string=w16)
  call "Trim Whitespace.gvi"(string=s3) -> (trimmed string=w17)
  call "Trim Whitespace.gvi"(string=s2) -> (trimmed string=w18)
  call "Trim Whitespace.gvi"(string=s6) -> (trimmed string=w19)
  case (w19) {
    frame "False", Default {
      w20 = "not found"
      w21 = w9
    }
    frame "{F1EC9F5D-A5BF-4B87-9643-AE4C475E86CC}" {
      w20 = "Roast"
      w21 = w9
    }
    frame "{5B1CB67A-C312-4AE7-A8CC-0AC096F56AAA}" {
      w20 = "Frying "
      w21 = w9
    }
    frame "{14154E87-4DC5-46BE-A48B-369C218CD08A}" {
      w20 = "Braise meat"
      w21 = w9
    }
    frame "{97A9653C-6FDC-4EC1-BA76-70CD3EEB0FEA}" {
      w20 = "Deep frying meat"
      w21 = w9
    }
    frame "{B51413B7-9B8D-4637-80BF-8E104B9D37FA}" {
      w20 = "Roast meat"
      w21 = w9
    }
    frame "{57B64B24-ABBC-474A-B337-4B1DD1C541B7}" {
      w20 = "Side dishes Cooking potatoes"
      w21 = w9
    }
    frame "{F522428E-4454-42D5-AC1B-C7618CC43EB9}" {
      w20 = "Fried eggs"
      w21 = w9
    }
    frame "{014E63A6-91B4-4932-9D64-9068A5E3899B}" {
      w20 = "Egg omelette"
      w21 = w9
    }
    frame "{A529A8EC-F6DB-452F-A216-BE9DCC4C0501}" {
      w20 = "Meat cooking"
      w21 = w9
    }
    frame "{7E754ABE-8CB2-4247-A03C-771CE4AD4177}" {
      w20 = " Fisch Dämpfen"
      w21 = w9
    }
    frame "{6C58E961-881D-4BC0-B912-44AA64F8AF47}" {
      w20 = "Sous vide meat"
      w21 = w9
    }
    frame "{1E8A5BED-9EDA-4629-90C3-3BE63CB36E87}" {
      w20 = "Meat confit"
      w21 = w9
    }
    frame "{2946233B-DF20-488C-BF5D-530094B87D8A}" {
      w20 = "Meat Sausages Broths"
      w21 = w9
    }
    frame "{52FC21C6-F65C-42AE-A157-7656AC49777C}" {
      w20 = "Meat ragout"
      w21 = w9
    }
    frame "{37CDD65D-B81B-4605-B93F-31FE9D24E38C}" {
      w20 = "Cooking meat overnight"
      w21 = w9
    }
    frame "{FC19B71C-36FA-4C91-A5B4-502BC8F5F499}" {
      w20 = "Milk and desserts Milk cooking"
      w21 = w9
    }
    frame "{FDEBAA55-C323-4B60-83BC-80848B186CC8}" {
      w20 = "Milk and desserts Pudding \n+ sauce"
      w21 = w9
    }
    frame "{8A51293C-76B5-4CA4-B1A1-805B98732F7B}" {
      w20 = "Egg dishes Kaiserschmarren"
      w21 = w9
    }
    frame "{222F2283-49FF-494B-8066-CA4A3BBE0CA8}" {
      w20 = "Suppen Saucen Convenience"
      w21 = w9
    }
    frame "{95806C6D-0802-45A1-8A0A-0582DB380211}" {
      w20 = "Finishing soups sauces"
      w21 = w9
    }
    frame "{A651D927-4794-4AC4-BD92-E9BB027911BF}" {
      w20 = "Soups Sauces Bechamel Veloute"
      w21 = w9
    }
    frame "{597A1F24-6518-4266-8571-1D3649E63D87}" {
      w20 = "Sides Polenta"
      w21 = w9
    }
    frame "{38BB32AC-4562-43A2-9674-977D416C477E}" {
      w20 = "Manual cooking"
      w21 = w9
    }
    frame "{5EC7E7CC-DBBD-40CE-AC81-D89745BD47D3}" {
      w20 = "Side dish cooking"
      w21 = w9
    }
    frame "{10E82303-A36B-4E79-8727-5FD1574C5581}" {
      w20 = "Milk and desserts Rice pudding"
      w21 = w9
    }
    frame "{5485695E-4E6C-487E-BF3C-1281D2BA0C01}" {
      w20 = "Poaching fish"
      w21 = w9
    }
    frame "{67A0CA04-D69E-4808-8B08-A194398AD7B5}" {
      w20 = "Steaming meat"
      w21 = w9
    }
    frame "{2E2A0F8E-5B00-4664-BCBF-2BDAECE5F57C}" {
      w20 = "Steam side dishes"
      w21 = w9
    }
    frame "{B5ACA17F-6B44-464C-B39D-0C05E5762E3A}" {
      w20 = "Fish confit"
      w21 = w9
    }
    frame "{DB8A4BB2-1225-4860-87BD-4984E36C9932}" {
      w20 = "Steaming milk and desserts"
      w21 = w9
    }
    frame "{547EC271-8C58-4708-927B-281C8BC5A576}" {
      w20 = "Deep-frying fish"
      w21 = w9
    }
    frame "{122129B2-3F4E-41D8-BB33-9BBDC5B13EF7}" {
      w20 = "Sous vide fish"
      w21 = w9
    }
    frame "{4BE1166B-089C-4E4B-8D2C-B987731C0613}" {
      w20 = "Fish Seafood Cooking"
      w21 = w9
    }
    frame "{A8E9604C-E19A-4FEC-88C6-C48D25EC8D37}" {
      w20 = "Egg dishes Poaching eggs"
      w21 = w9
    }
    frame "{6509EAAB-9A69-45A6-95CB-6011F01160F8}" {
      w20 = "Side dishes rice cooking"
      w21 = w9
    }
    frame "{53CEBCBE-F670-474B-B751-A9F9637B2A5F}" {
      w20 = "JP Tamagoyaki egg dishes"
      w21 = w9
    }
    frame "{DB0F7019-5A7D-45D0-B9B4-C0C46D148E50}" {
      w20 = "JP Gyoza side dishes"
      w21 = w9
    }
    frame "{9CCDFF89-5F32-433A-872F-E856C13753EB}" {
      w20 = "Side dishes sous vide"
      w21 = w9
    }
    frame "{76CCAED3-46A9-4528-A2E4-0F67229A6CFE}" {
      w20 = "Side dishes sous vide"
      w21 = w9
    }
    frame "{D905FC70-26FE-4361-841C-CF7EB5AB02F8}" {
      w20 = "Meat overnight ragout"
      w21 = w9
    }
    frame "{AC90B87A-851F-4974-AF85-3BBEBA4CA38A}" {
      w20 = "Braise fish"
      w21 = w9
    }
    frame "{6007EF01-EB38-4F45-ADBE-B5F936248095}" {
      w20 = "Finishing Glaze inserts"
      w21 = w9
    }
    frame "{C35385BF-4660-4C69-936A-51376368D360}" {
      w20 = "Finishing meat in a sauce"
      w21 = w9
    }
    frame "{73CC0056-87E2-4D31-8DA3-8ACCD77928EC}" {
      w20 = "Soups Sauces Soup"
      w21 = w9
    }
    frame "{8615E55F-80DF-4BA1-84A7-0335FA572EB5}" {
      w20 = "Scrambled egg dishes"
      w21 = w9
    }
    frame "{6C265656-689C-4C74-9A9F-635C1EDE38C2}" {
      w20 = "Egg dishes JP Onsen Tamago"
      w21 = w9
    }
    frame "{7CF10941-AA8B-41BA-8426-4DA4C4898039}" {
      w20 = "Fish Seafood Roast"
      w21 = w9
    }
    frame "{91536D42-994F-4C24-88AD-1457CDB19811}" {
      w20 = "Dairy and sweet dishes \nDeep-frying"
      w21 = w9
    }
    frame "{472F76E4-F1B6-4670-B4BD-5F74F50A6726}" {
      w20 = "Dairy and sweet dishes \nRoasting nuts"
      w21 = w9
    }
    frame "{73326502-244E-4CB6-BFE7-01A18EDA5593}" {
      w20 = "Milk and desserts Melting \nchocolate"
      w21 = w9
    }
    frame "{A9DF25A7-FEA7-459B-894F-96E0C61112C2}" {
      w20 = "Side dishes Confit"
      w21 = w9
    }
    frame "{7DE9039C-B156-4C43-A0C6-E41A53FC3210}" {
      w20 = "Stew meat overnight"
      w21 = w9
    }
    frame "{C99C0D43-0C2C-4451-BA82-DCFB1F475218}" {
      w20 = "Dairy and desserts Sugar Cooking Caramel"
      w21 = w9
    }
    frame "{5BE910D5-95CA-48F7-B027-89DEBC6F0D48}" {
      w20 = "Dairy and desserts Fruits Cooking"
      w21 = w9
    }
    frame "{03DADB22-5777-4F09-9A84-B11C0EF7331E}" {
      w20 = "Soup sauces"
      w21 = w9
    }
    frame "{2EB2C441-89BB-4F1B-BDC0-2EF3CD16DA44}" {
      w20 = "Reduce soups sauces"
      w21 = w9
    }
    frame "{A5141EF1-787E-4873-BB49-8FEE8C978DD9}" {
      w20 = "Soups Sauces Stock"
      w21 = w9
    }
    frame "{C6D16EC3-090F-4B6A-B265-D51BA2DA34CD}" {
      w20 = "Egg dishes Cooking eggs"
      w21 = w9
    }
    frame "{7BCAA527-D2C7-420E-A091-94C893153871}" {
      w20 = "Egg dishes Pancakes"
      w21 = w9
    }
    frame "{443EEC20-C943-456F-9D9B-87410095870B}" {
      w20 = "Fish roast"
      w21 = w9
    }
    frame "{795A0A29-9C80-411C-900A-6AA5BACD50BC}" {
      w20 = "Side dishes Cooking Pressure"
      w21 = w9
    }
    frame "{88A398A6-EC7E-436E-A76F-70CB1E0CF5B6}" {
      w20 = "Meat cooking Pressure"
      w21 = w9
    }
    frame "{EA019C20-C014-4934-89E9-44011905A173}" {
      w20 = "Meat ragout Pressure"
      w21 = w9
    }
    frame "{B980EDF7-A5FB-4EA3-ABFC-952E6564AE75}" {
      w20 = "Stewing meat Pressure"
      w21 = w9
    }
    frame "{07CC88AC-A9D4-4103-A636-413A091EB32A}" {
      w20 = "Side dishes Potatoes \nCooking Pressure"
      w21 = w9
    }
    frame "{5B2D83A6-92A7-4840-A26B-DDB529C430DB}" {
      w20 = "Milk and desserts \"Kaiserschmarren\""
      w21 = w9
    }
    frame "{ED462232-9AC4-4E4D-A985-2B18BBA364EA}" {
      w20 = "Side dishes Cooking pasta"
      w21 = w9
    }
    frame "{F50B26FB-7796-42EC-97DB-7A5F94F2CF65}" {
      w20 = "Milk and dessert crepes"
      w21 = w9
    }
    frame "{C3BBC1E5-DA7A-43C6-9E52-42994DE41622}" {
      w20 = "Soups Sauces Sauce"
      w21 = w9
    }
    frame "{924FF526-99F8-46DF-9630-9F42070E98C1}" {
      w20 = "Soups Sauces Soup pressure"
      w21 = w9
    }
    frame "{E55731C2-5F76-47DF-8F87-DBBA0537A070}" {
      w20 = "Soups Sauces Sauce pressure"
      w21 = w9
    }
    frame "{64E6B664-4CAD-4A58-9231-70CFA1089E33}" {
      w20 = "Soups Sauces Stock pressure"
      w21 = w9
    }
    frame "{69268FFB-712D-47A1-AF8E-8B2D52012A0E}" {
      w20 = "Fish stewing pressure"
      w21 = w9
    }
    frame "{9CF563D2-67DC-49D6-A3BB-FA8318EA067E}" {
      w20 = "Side dishes paella"
      w21 = w9
    }
    frame "{CFBA3DDE-EDF5-4CF0-A7D2-428E8711FA88}" {
      w20 = "Risotto side dishes"
      w21 = w9
    }
    frame "{F937A38A-D1EC-4ED5-BEB1-7B1CF1A94AE0}" {
      w20 = "Meat CHN Stew"
      w21 = w9
    }
    frame "{75CD3EB0-53AB-4897-9C84-C7534772A2B6}" {
      w20 = "Sides Convenience puree"
      w21 = w9
    }
    frame "{96FB24CF-DC88-4D4E-98B0-7E0CE0B689BF}" {
      w20 = "Side dishes CHN Congee"
      w21 = w9
    }
    frame "{0A22FFEB-ED15-472F-8FF1-B76A2EC21533}" {
      w20 = "Sides CHN Fried Dumplings \nGyoza"
      w21 = w9
    }
    frame "{DCB143C5-3975-4CFD-831D-43B09E44A668}" {
      w20 = "Side dishes Rice Cooking \nPressure"
      w21 = w9
    }
    frame "{BB176372-E97A-4B34-8FC0-4FAD83387144}" {
      w20 = "Supplements CHN Zongzi \npressure"
      w21 = w9
    }
    frame "{59111FFD-294C-41A3-A52F-752E4BAABDF8}" {
      w20 = "Meat CHN Lou Mei"
      w21 = w9
    }
    frame "{23754E7C-F5C5-4070-A6F1-DC83EB5E20BF}" {
      w20 = "Meat CHN Lou Mei"
      w21 = w9
    }
    frame "{F35A640B-645D-43FD-842C-A853152BA4C4}" {
      w20 = "Fish roast WA82"
      w21 = w9
    }
    frame "{99846438-F5BE-4382-9C26-941F462CDA99}" {
      w20 = "Fish Seafood Roast \nWA82"
      w21 = w9
    }
    frame "{6FC603A5-8658-4BFA-9EA0-F486C96DB74D}" {
      w20 = "Side dishes Roast WA82"
      w21 = w9
    }
    frame "{26F12F90-7E27-4406-90CE-E34289F818F0}" {
      w20 = "Glaze inserts WA82"
      w21 = w9
    }
    frame "{9A990D7D-2DF2-44B4-B9C2-630F44D6412F}" {
      w20 = "Egg dishes and desserts Fried eggs WA82"
      w21 = w9
    }
    frame "{DEDE609F-A6C1-47AD-A5D0-5DFB47355999}" {
      w20 = "Egg dishes and desserts Omelette \nWA82"
      w21 = w9
    }
    frame "{B5CE2367-6200-4652-B2D0-E08EFBBACFB9}" {
      w20 = "Egg dishes and desserts DACH FI HU Kaiserschmarren WA82"
      w21 = w9
    }
    frame "{E69CB6E7-E860-4BD4-B460-AC2EA622B61B}" {
      w20 = "Egg dishes and desserts JP \nTamagoyaki WA82"
      w21 = w9
    }
    frame "{9D192AFB-45B8-4D02-A041-4C105FC5ADA2}" {
      w20 = "Egg dishes and desserts Scrambled \neggs WA82"
      w21 = w9
    }
    frame "{2625CA6C-E1D8-44C2-AA3B-207080DA68A9}" {
      w20 = "Egg dishes and desserts Roast nuts WA82"
      w21 = w9
    }
    frame "{00B6654E-672C-4D9C-9AC7-8CFDA3C59347}" {
      w20 = "Egg dishes and desserts Crepes \nWA82"
      w21 = w9
    }
    frame "{E4F37828-8746-4F63-9C0D-65F6CA02EFFA}" {
      w20 = "Meat Stir Fry"
      w21 = w9
    }
    frame "{8D4DE10D-484A-4A6C-9232-5DDA5618E590}" {
      w20 = "Fish Stir Fry"
      w21 = w9
    }
    frame "{A72468FC-43BB-431A-AB51-EC8D5A7C5379}" {
      w20 = "Stir Fry side dishes"
      w21 = w9
    }
  }
  call "Trim Whitespace.gvi"(string=w20) -> (trimmed string=w22)
  Property Node(instance in=T1 {all zero or empty}, "Device type:"=w15, "Device side:"=s7, "Serial number:"=w16, "Start date:"=w17, "Charge number:"=w14, "Prozess-Typ:"="Operating mode / \nCooking process", "Cooking programme name:"=w22, "Energy consumption:"=$"Energy consumption:", "Software version:"=w18) -> (instance out=w23)
  $Spezifications <- w23
  $"Start date" <- s3
  $"Serial number" <- s4
  $"Device Type" <- s1
  $"Error out" <- w21
  $"Charge nr" <- w14
  case (s8) {
    frame "1" {
      w24 = "°F"
    }
    frame "0", Default {
      w24 = "°C"
    }
  }
  $"Temp Einheit" <- w24
  $GUID <- w19
